# Dynamo custom node ColumnFamilies.dyf (Dynamo 2.16.2.5624)
# category: BLIBET_NODES_2025.LoadableFamilies.Arquitecture.Build.Actions

python_script = Python()  # CPython3
# ---------- python_script.python (62 lines) ----------
import System
import clr

#import DSCoreNodes
clr.AddReference('DSCoreNodes')
from DSCore import *

#Import ProtoGeometry
clr.AddReference('ProtoGeometry')
from Autodesk.DesignScript.Geometry import *

# Import RevitNodes
clr.AddReference("RevitNodes")
from Revit import *
import Revit
clr.ImportExtensions(Revit.Elements)
clr.ImportExtensions(Revit.GeometryConversion)

# Import Revit elements
from Revit.Elements import *

# Import RevitAPI
clr.AddReference("RevitAPI")
import Autodesk
from Autodesk.Revit.DB import *

# Import DocumentManager
clr.AddReference("RevitServices")
from RevitServices.Persistence import DocumentManager
from RevitServices.Transactions import TransactionManager


#Get Document
doc = DocumentManager.Instance.CurrentDBDocument
######################################################
#Inputs
columns_collector=FilteredElementCollector(doc).OfCategory(BuiltInCategory.OST_Columns).WhereElementIsElementType().ToElements()

structural_columns_collector=FilteredElementCollector(doc).OfCategory(BuiltInCategory.OST_StructuralColumns).WhereElementIsElementType().ToElements()
######################################################
# Start Code
TransactionManager.Instance.EnsureInTransaction(doc)
column_families=[]
column_family_names=[]
for column in columns_collector:
    this_column=column.Family
    if this_column.Name not in column_family_names:
        column_family_names.append(this_column.Name)
        column_families.append(this_column)

family_structural_columns=[]
family_structural_column_names=[]
for structural_column in structural_columns_collector:
    thisStructuralColumn=structural_column.Family
    if thisStructuralColumn.Name not in family_structural_column_names:
        family_structural_column_names.append(thisStructuralColumn.Name)
        family_structural_columns.append(thisStructuralColumn)

TransactionManager.Instance.TransactionTaskDone()
######################################################
# Output
OUT = column_families,family_structural_columns
# ----------------------------------------
code_block = CodeBlock(x=python_script) { x[0]; x[1]; }
Columns = Output(code_block.out0)
StructuralColumns = Output(code_block.out1)
