# Dynamo custom node CreatePipe.dyf (Dynamo 2.16.2.5624)
# category: BLIBET_NODES_2025.Pipes.Create

SistemType = Input(SistemType: var[]..[])
PipeType = Input(PipeType: var[]..[])
level = Input(level: var[]..[])
StartPoint = Input(StartPoint: var[]..[])
EndPoint = Input(EndPoint: var[]..[])
MiddleElevation = Input(MiddleElevation: var[]..[])
python_script = Python(IN[0]=SistemType, IN[1]=PipeType, IN[2]=level, IN[3]=StartPoint, IN[4]=EndPoint, IN[5]=MiddleElevation)  # CPython3
# ---------- python_script.python (56 lines) ----------
import System
import clr

#import DSCoreNodes
clr.AddReference('DSCoreNodes')
from DSCore import *

#Import ProtoGeometry
clr.AddReference('ProtoGeometry')
from Autodesk.DesignScript.Geometry import *

# Import RevitNodes
clr.AddReference("RevitNodes")
from Revit import *
import Revit
clr.ImportExtensions(Revit.Elements)
clr.ImportExtensions(Revit.GeometryConversion)

# Import Revit elements
from Revit.Elements import *

# Import RevitAPI
clr.AddReference("RevitAPI")
import Autodesk
from Autodesk.Revit.DB import *

import Autodesk.Revit.DB.Plumbing

# Import DocumentManager
clr.AddReference("RevitServices")
from RevitServices.Persistence import DocumentManager
from RevitServices.Transactions import TransactionManager


#Get Document
doc = DocumentManager.Instance.CurrentDBDocument
######################################################
#Inputs
system_type_id = UnwrapElement(IN[0])[0].Id
pipe_type_id = UnwrapElement(IN[1])[0].Id
Level_id = UnwrapElement(IN[2]).Id
start_point = UnwrapElement(IN[3])
end_point = UnwrapElement(IN[4])
middle_elevation = UnwrapElement(IN[5])
######################################################
# Start Code
TransactionManager.Instance.EnsureInTransaction(doc)
sp=XYZ(0,0,0)
ep=XYZ(2,0,0)
create_pipe=Plumbing.Pipe.Create(doc,system_type_id,pipe_type_id,Level_id,sp,ep)
#x=create_pipe.get_Parameter(BuiltInParameter.RBS_OFFSET_PARAM)

TransactionManager.Instance.TransactionTaskDone()
######################################################
# Output
OUT = create_pipe
# ----------------------------------------
Pipe = Output(python_script)
