# Dynamo custom node CreatePipeScheduleType.dyf (Dynamo 2.16.2.5624)
# category: BLIBET_NODES_2025.Pipes.Create

Name = Input(Name: var[]..[])
python_script = Python(IN[0]=Name)  # CPython3
# ---------- python_script.python (53 lines) ----------
import System
import clr

#import DSCoreNodes
clr.AddReference('DSCoreNodes')
from DSCore import *

#Import ProtoGeometry
clr.AddReference('ProtoGeometry')
from Autodesk.DesignScript.Geometry import *

# Import RevitNodes
clr.AddReference("RevitNodes")
from Revit import *
import Revit
clr.ImportExtensions(Revit.Elements)
clr.ImportExtensions(Revit.GeometryConversion)

# Import Revit elements
from Revit.Elements import *

# Import RevitAPI
clr.AddReference("RevitAPI")
import Autodesk
from Autodesk.Revit.DB import *
import Autodesk.Revit.DB.Plumbing

# Import DocumentManager
clr.AddReference("RevitServices")
from RevitServices.Persistence import DocumentManager
from RevitServices.Transactions import TransactionManager


#Get Document
doc = DocumentManager.Instance.CurrentDBDocument
######################################################
#Inputs
ScheduleName = UnwrapElement(IN[0]) 

######################################################
# Start Code
TransactionManager.Instance.EnsureInTransaction(doc)

try:
    CreatePipeScheduleType = Plumbing.PipeScheduleType.Create(doc,ScheduleName)
except:
    PipeScheduleTypes = FilteredElementCollector(doc).OfCategory(BuiltInCategory.OST_PipeSchedules).WhereElementIsElementType().ToElements()
    CreatePipeScheduleType = filter(lambda pipeSchedule:pipeSchedule.get_Parameter(BuiltInParameter.SYMBOL_NAME_PARAM).AsString()==ScheduleName, PipeScheduleTypes)

TransactionManager.Instance.TransactionTaskDone()
######################################################
# Output
OUT = CreatePipeScheduleType
# ----------------------------------------
ScheduleType = Output(python_script)
