# Dynamo custom node CreatePipeSegments.dyf (Dynamo 2.16.2.5624)
# category: BLIBET_NODES_2025.Pipes.Create

PipeMaterial = Input(PipeMaterial: var[]..[])
PipeScheduleType = Input(PipeScheduleType: var[]..[])
PipeMEPSize_AsArray = Input(PipeMEPSize_AsArray: var[]..[])
python_script = Python(IN[0]=PipeMaterial, IN[1]=PipeScheduleType, IN[2]=PipeMEPSize_AsArray)  # CPython3
# ---------- python_script.python (59 lines) ----------
import System
import clr


from System.Collections.Generic import List


#import DSCoreNodes
clr.AddReference('DSCoreNodes')
from DSCore import *

#Import ProtoGeometry
clr.AddReference('ProtoGeometry')
from Autodesk.DesignScript.Geometry import *

# Import RevitNodes
clr.AddReference("RevitNodes")
from Revit import *
import Revit
clr.ImportExtensions(Revit.Elements)
clr.ImportExtensions(Revit.GeometryConversion)

# Import Revit elements
from Revit.Elements import *

# Import RevitAPI
clr.AddReference("RevitAPI")
import Autodesk
from Autodesk.Revit.DB import *
import Autodesk.Revit.DB.Plumbing

# Import DocumentManager
clr.AddReference("RevitServices")
from RevitServices.Persistence import DocumentManager
from RevitServices.Transactions import TransactionManager


#Get Document
doc = DocumentManager.Instance.CurrentDBDocument
######################################################
#Inputs
Material = UnwrapElement(IN[0]).Id
Schedule =UnwrapElement(IN[1])[0].Id
MEPSizeArray = UnwrapElement(IN[2])

######################################################
# Start Code
TransactionManager.Instance.EnsureInTransaction(doc)

MEPSize_Collection=clr.System.Collections.Generic.List[MEPSize]()
for sublist in MEPSizeArray:
    MEPSize_Collection.Add(MEPSize(sublist[0],sublist[1],sublist[2],True,True))

create_segment=Plumbing.PipeSegment.Create(doc, Material, Schedule, MEPSize_Collection)
    
TransactionManager.Instance.TransactionTaskDone()
######################################################

OUT = create_segment
# ----------------------------------------
