# Dynamo custom node CreatePipe_ByStrings.dyf (Dynamo 2.16.2.5624)
# category: BLIBET_NODES_2025.Pipes.Create

SistemType = Input(SistemType: var[]..[])
python_script = Python(IN[0]=SistemType)  # CPython3
# ---------- python_script.python (49 lines) ----------
import System
import clr

#import DSCoreNodes
clr.AddReference('DSCoreNodes')
from DSCore import *

#Import ProtoGeometry
clr.AddReference('ProtoGeometry')
from Autodesk.DesignScript.Geometry import *

# Import RevitNodes
clr.AddReference("RevitNodes")
from Revit import *
import Revit
clr.ImportExtensions(Revit.Elements)
clr.ImportExtensions(Revit.GeometryConversion)

# Import Revit elements
from Revit.Elements import *

# Import RevitAPI
clr.AddReference("RevitAPI")
import Autodesk
from Autodesk.Revit.DB import *

# Import DocumentManager
clr.AddReference("RevitServices")
from RevitServices.Persistence import DocumentManager
from RevitServices.Transactions import TransactionManager


#Get Document
doc = DocumentManager.Instance.CurrentDBDocument
######################################################
#Inputs
piping_system_name=UnwrapElement(IN[0])
######################################################
# Start Code
TransactionManager.Instance.EnsureInTransaction(doc)
piping_systems=FilteredElementCollector(doc).OfCategory(BuiltInCategory.OST_PipingSystem).WhereElementIsElementType().ToElements()


piping_system_by_name=filter(lambda system:system.get_Parameter(BuiltInParameter.SYMBOL_NAME_PARAM).AsValueString()==piping_system_name,piping_systems)

TransactionManager.Instance.TransactionTaskDone()
######################################################
# Output
OUT = piping_system_by_name
# ----------------------------------------
PipeType = Input(PipeType: var[]..[])
python_script_2 = Python(IN[0]=PipeType)  # CPython3
# ---------- python_script_2.python (48 lines) ----------
import System
import clr

#import DSCoreNodes
clr.AddReference('DSCoreNodes')
from DSCore import *

#Import ProtoGeometry
clr.AddReference('ProtoGeometry')
from Autodesk.DesignScript.Geometry import *

# Import RevitNodes
clr.AddReference("RevitNodes")
from Revit import *
import Revit
clr.ImportExtensions(Revit.Elements)
clr.ImportExtensions(Revit.GeometryConversion)

# Import Revit elements
from Revit.Elements import *

# Import RevitAPI
clr.AddReference("RevitAPI")
import Autodesk
from Autodesk.Revit.DB import *

# Import DocumentManager
clr.AddReference("RevitServices")
from RevitServices.Persistence import DocumentManager
from RevitServices.Transactions import TransactionManager


#Get Document
doc = DocumentManager.Instance.CurrentDBDocument
######################################################
#Inputs
pipe_type_name=IN[0]
######################################################
# Start Code
TransactionManager.Instance.EnsureInTransaction(doc)
pipe_types=FilteredElementCollector(doc).OfCategory(BuiltInCategory.OST_PipeCurves).WhereElementIsElementType().ToElements()
    
pipe_type_by_name=filter(lambda pipe_type:pipe_type.get_Parameter(BuiltInParameter.SYMBOL_NAME_PARAM).AsValueString() == pipe_type_name,pipe_types)

TransactionManager.Instance.TransactionTaskDone()
######################################################
# Output
OUT = pipe_type_by_name
# ----------------------------------------
level = Input(level: var[]..[])
StartPoint = Input(StartPoint: var[]..[])
EndPoint = Input(EndPoint: var[]..[])
MiddleElevation = Input(MiddleElevation: var[]..[])
python_script_3 = Python(IN[0]=python_script, IN[1]=python_script_2, IN[2]=level, IN[3]=StartPoint, IN[4]=EndPoint, IN[5]=MiddleElevation)  # CPython3
# ---------- python_script_3.python (63 lines) ----------
import System
import clr

#import DSCoreNodes
clr.AddReference('DSCoreNodes')
from DSCore import *

#Import ProtoGeometry
clr.AddReference('ProtoGeometry')
from Autodesk.DesignScript.Geometry import *

# Import RevitNodes
clr.AddReference("RevitNodes")
from Revit import *
import Revit
clr.ImportExtensions(Revit.Elements)
clr.ImportExtensions(Revit.GeometryConversion)

# Import Revit elements
from Revit.Elements import *

# Import RevitAPI
clr.AddReference("RevitAPI")
import Autodesk
from Autodesk.Revit.DB import *

import Autodesk.Revit.DB.Plumbing

# Import DocumentManager
clr.AddReference("RevitServices")
from RevitServices.Persistence import DocumentManager
from RevitServices.Transactions import TransactionManager


#Get Document
doc = DocumentManager.Instance.CurrentDBDocument
######################################################
#Inputs
system_type_id = UnwrapElement(IN[0])[0].Id
pipe_type_id = UnwrapElement(IN[1])[0].Id
Level_id = UnwrapElement(IN[2]).Id
start_point = UnwrapElement(IN[3])
end_point = UnwrapElement(IN[4])
middle_elevation = UnwrapElement(IN[5])
######################################################
# Start Code
TransactionManager.Instance.EnsureInTransaction(doc)

pipes=[]
index = 0
for point in start_point:
    sp=start_point[index].ToXyz()
    ep=end_point[index].ToXyz()
    create_pipe=Plumbing.Pipe.Create(doc,system_type_id,pipe_type_id,Level_id,sp,ep)
    pipes.append(create_pipe)
    index += 1

#x=create_pipe.get_Parameter(BuiltInParameter.RBS_OFFSET_PARAM)

TransactionManager.Instance.TransactionTaskDone()
######################################################
# Output
OUT = pipes
# ----------------------------------------
Pipe = Output(python_script_3)
