# Dynamo custom node DimensionTypes.dyf (Dynamo 2.16.2.5624)
# category: BLIBET_NODES_2025.Annotate.Dimension.Actions

python_script = Python()  # CPython3
# ---------- python_script.python (69 lines) ----------
import System
import clr

#import DSCoreNodes
clr.AddReference('DSCoreNodes')
from DSCore import *

#Import ProtoGeometry
clr.AddReference('ProtoGeometry')
from Autodesk.DesignScript.Geometry import *

# Import RevitNodes
clr.AddReference("RevitNodes")
from Revit import *
import Revit
clr.ImportExtensions(Revit.Elements)
clr.ImportExtensions(Revit.GeometryConversion)

# Import Revit elements
from Revit.Elements import *

# Import RevitAPI
clr.AddReference("RevitAPI")
import Autodesk
from Autodesk.Revit.DB import *

# Import DocumentManager
clr.AddReference("RevitServices")
from RevitServices.Persistence import DocumentManager
from RevitServices.Transactions import TransactionManager


#Get Document
doc = DocumentManager.Instance.CurrentDBDocument
######################################################
#Inputs
dimension_types=FilteredElementCollector(doc).OfClass(DimensionType).WhereElementIsElementType().ToElements()


family_names=[]

for dimension_type in dimension_types:
    this_family_name=dimension_type.get_Parameter(BuiltInParameter.SYMBOL_FAMILY_NAME_PARAM).AsValueString()
    if this_family_name not in family_names:
        family_names.append(this_family_name)

group_by_type=[]
for type_name in family_names:
    
    this_filter=filter(lambda type:type.get_Parameter(BuiltInParameter.SYMBOL_FAMILY_NAME_PARAM).AsValueString()==type_name,dimension_types)
    sub_element_list=[]
    sub_family_name_list=[]
    sub_type_name_list=[]
    for element in this_filter:
        tester=element.get_Parameter(BuiltInParameter.SYMBOL_NAME_PARAM).AsValueString()
        if len(tester)>0:
            sub_element_list.append(element)
            sub_family_name_list.append(element.get_Parameter(BuiltInParameter.SYMBOL_FAMILY_NAME_PARAM).AsValueString())
            sub_type_name_list.append(element.get_Parameter(BuiltInParameter.SYMBOL_NAME_PARAM).AsValueString())
    group_by_type.append({"01_dimension_type":[type_name],"02_elements":sub_element_list,"03_family_name":sub_family_name_list,"04_type_name":sub_type_name_list})
######################################################
# Start Code
TransactionManager.Instance.EnsureInTransaction(doc)

    
TransactionManager.Instance.TransactionTaskDone()
######################################################
# Output
OUT = group_by_type
# ----------------------------------------
Dictionary = Output(python_script)
code_block = CodeBlock { "01_dimension_type"; }
valueAtKey = DesignScript.Builtin.Dictionary.ValueAtKey(dictionary=python_script, key=code_block)
flatten = List.Flatten(list=valueAtKey)
Dymension_Types = Output(flatten)
code_block_2 = CodeBlock { "02_elements"; }
valueAtKey_2 = DesignScript.Builtin.Dictionary.ValueAtKey(dictionary=python_script, key=code_block_2)
Elements = Output(valueAtKey_2)
code_block_3 = CodeBlock { "03_family_name"; }
valueAtKey_3 = DesignScript.Builtin.Dictionary.ValueAtKey(dictionary=python_script, key=code_block_3)
Family_Names = Output(valueAtKey_3)
code_block_4 = CodeBlock { "04_type_name"; }
valueAtKey_4 = DesignScript.Builtin.Dictionary.ValueAtKey(dictionary=python_script, key=code_block_4)
Type_Names = Output(valueAtKey_4)
