# Dynamo custom node Document_Categories.dyf (Dynamo 2.13.1.3887)
# category: BLIBET_NODES_2025.Document.Categories.Actions

python_script = Python()  # CPython3
# ---------- python_script.python (72 lines) ----------
import System
import clr

#import DSCoreNodes
clr.AddReference('DSCoreNodes')
from DSCore import *

#Import ProtoGeometry
clr.AddReference('ProtoGeometry')
from Autodesk.DesignScript.Geometry import *

# Import RevitNodes
clr.AddReference("RevitNodes")
from Revit import *
import Revit
clr.ImportExtensions(Revit.Elements)
clr.ImportExtensions(Revit.GeometryConversion)

# Import Revit elements
from Revit.Elements import *

# Import RevitAPI
clr.AddReference("RevitAPI")
import Autodesk
from Autodesk.Revit.DB import *

# Import DocumentManager
clr.AddReference("RevitServices")
from RevitServices.Persistence import DocumentManager
from RevitServices.Transactions import TransactionManager


#Get Document
doc = DocumentManager.Instance.CurrentDBDocument
######################################################
document_categories=doc.Settings.get_Categories()

category_names_list=[]
sorted_category_name_list=[]
categories_list=[]
for document_category in document_categories:
    categories_list.append(document_category)
    category_names_list.append(document_category.Name)
    sorted_category_name_list.append(document_category.Name)
    sorted_category_name_list.sort()
    
sorted_elements=[]
for sorted_category_name in sorted_category_name_list:
    sorted_elements.append(categories_list[category_names_list.index(sorted_category_name)])

sorted_category_names_list=[]
sorted_category_ids=[]
sorted_category_types=[]
for sorted_element in sorted_elements:
    sorted_category_names_list.append(sorted_element.Name)
    sorted_category_ids.append(sorted_element.Id)
    this_category_type=sorted_element.CategoryType
    if this_category_type == 1:
        this_category_type_as_String="Model"
    elif this_category_type == 2:
        this_category_type_as_String="Annotation"
    elif this_category_type == 4:
        this_category_type_as_String="Interal"
    elif this_category_type == 5:
        this_category_type_as_String="AnalyticalModel"
    else:
        this_category_type_as_String="Invalid"
    sorted_category_types.append(this_category_type_as_String)

######################################################
# Output
OUT = sorted_category_names_list,sorted_category_ids,sorted_category_types
# ----------------------------------------
code_block = CodeBlock(x=python_script) { x[0]; x[1]; x[2]; }
Categories = Output(code_block.out0)
CategoryIds = Output(code_block.out1)
CategoryTypes = Output(code_block.out2)
