# Dynamo custom node DoorFamilies.dyf (Dynamo 2.16.2.5624)
# category: BLIBET_NODES_2025.LoadableFamilies.Arquitecture.Build.Actions

python_script = Python()  # CPython3
# ---------- python_script.python (49 lines) ----------
import System
import clr

#import DSCoreNodes
clr.AddReference('DSCoreNodes')
from DSCore import *

#Import ProtoGeometry
clr.AddReference('ProtoGeometry')
from Autodesk.DesignScript.Geometry import *

# Import RevitNodes
clr.AddReference("RevitNodes")
from Revit import *
import Revit
clr.ImportExtensions(Revit.Elements)
clr.ImportExtensions(Revit.GeometryConversion)

# Import Revit elements
from Revit.Elements import *

# Import RevitAPI
clr.AddReference("RevitAPI")
import Autodesk
from Autodesk.Revit.DB import *

# Import DocumentManager
clr.AddReference("RevitServices")
from RevitServices.Persistence import DocumentManager
from RevitServices.Transactions import TransactionManager


#Get Document
doc = DocumentManager.Instance.CurrentDBDocument
######################################################
#Inputs
door_families_collector=FilteredElementCollector(doc).OfCategory(BuiltInCategory.OST_Doors).WhereElementIsElementType().ToElements()
######################################################
door_families=[]
family_names=[]
for door in door_families_collector:
    this_door=door.Family
    if this_door.Name not in family_names:
        family_names.append(this_door.Name)
        door_families.append(this_door)

######################################################
# Output
OUT = door_families
# ----------------------------------------
Doors = Output(python_script)
