# Dynamo custom node Get_Categories_By_Id.dyf (Dynamo 2.13.1.3887)
# category: BLIBET_NODES_2025.Document.Categories.Query

Element_Ids = Input(Element_Ids: var[]..[])
python_script = Python(IN[0]=Element_Ids)  # CPython3
# ---------- python_script.python (68 lines) ----------
import System
import clr

#import DSCoreNodes
clr.AddReference('DSCoreNodes')
from DSCore import *

#Import ProtoGeometry
clr.AddReference('ProtoGeometry')
from Autodesk.DesignScript.Geometry import *

# Import RevitNodes
clr.AddReference("RevitNodes")
from Revit import *
import Revit
clr.ImportExtensions(Revit.Elements)
clr.ImportExtensions(Revit.GeometryConversion)

# Import Revit elements
from Revit.Elements import *

# Import RevitAPI
clr.AddReference("RevitAPI")
import Autodesk
from Autodesk.Revit.DB import *

# Import DocumentManager
clr.AddReference("RevitServices")
from RevitServices.Persistence import DocumentManager
from RevitServices.Transactions import TransactionManager


#Get Document
doc = DocumentManager.Instance.CurrentDBDocument
######################################################
#Inputs
category_id_input = UnwrapElement(IN[0])
if isinstance(category_id_input,list):
    category_id_input_list=category_id_input
else:
    category_id_input_list=[category_id_input]

######################################################
# Start Code
category_types=[]
category_names=[]
for category_id in category_id_input_list:
    thisCategory=Category.GetCategory(doc,category_id)
    category_names.append(thisCategory.Name)
    this_category_type=thisCategory.CategoryType
    if this_category_type == 1:
        this_category_type_as_String="Model"
    elif this_category_type == 2:
        this_category_type_as_String="Annotation"
    elif this_category_type == 4:
        this_category_type_as_String="Interal"
    elif this_category_type == 5:
        this_category_type_as_String="AnalyticalModel"
    else:
        this_category_type_as_String="Invalid"
    category_types.append(this_category_type_as_String)
TransactionManager.Instance.EnsureInTransaction(doc)

    
TransactionManager.Instance.TransactionTaskDone()
######################################################
# Output
OUT = category_names,category_types
# ----------------------------------------
code_block = CodeBlock(x=python_script) { x[0]; x[1]; }
Categories = Output(code_block.out0)
Category_Types = Output(code_block.out1)
