# Dynamo custom node Materials.dyf (Dynamo 2.16.2.5624)
# category: BLIBET_NODES_2025.Manage.Actions

python_script = Python()  # CPython3
# ---------- python_script.python (47 lines) ----------
import System
import clr

#import DSCoreNodes
clr.AddReference('DSCoreNodes')
from DSCore import *

#Import ProtoGeometry
clr.AddReference('ProtoGeometry')
from Autodesk.DesignScript.Geometry import *

# Import RevitNodes
clr.AddReference("RevitNodes")
from Revit import *
import Revit
clr.ImportExtensions(Revit.Elements)
clr.ImportExtensions(Revit.GeometryConversion)

# Import Revit elements
from Revit.Elements import *

# Import RevitAPI
clr.AddReference("RevitAPI")
import Autodesk
from Autodesk.Revit.DB import *

# Import DocumentManager
clr.AddReference("RevitServices")
from RevitServices.Persistence import DocumentManager
from RevitServices.Transactions import TransactionManager


#Get Document
doc = DocumentManager.Instance.CurrentDBDocument
######################################################
#Inputs
material_collector=FilteredElementCollector(doc).OfClass(Material).WhereElementIsNotElementType().ToElements()

######################################################
# Start Code
TransactionManager.Instance.EnsureInTransaction(doc)

    
TransactionManager.Instance.TransactionTaskDone()
######################################################
# Output
OUT = material_collector
# ----------------------------------------
Materials = Output(python_script)
