# Dynamo custom node PiPingSystemByName.dyf (Dynamo 2.16.2.5624)
# category: BLIBET_NODES_2025.Pipes.Query

PipingSystemName = Input(PipingSystemName: var[]..[])
python_script = Python(IN[0]=PipingSystemName)  # CPython3
# ---------- python_script.python (49 lines) ----------
import System
import clr

#import DSCoreNodes
clr.AddReference('DSCoreNodes')
from DSCore import *

#Import ProtoGeometry
clr.AddReference('ProtoGeometry')
from Autodesk.DesignScript.Geometry import *

# Import RevitNodes
clr.AddReference("RevitNodes")
from Revit import *
import Revit
clr.ImportExtensions(Revit.Elements)
clr.ImportExtensions(Revit.GeometryConversion)

# Import Revit elements
from Revit.Elements import *

# Import RevitAPI
clr.AddReference("RevitAPI")
import Autodesk
from Autodesk.Revit.DB import *

# Import DocumentManager
clr.AddReference("RevitServices")
from RevitServices.Persistence import DocumentManager
from RevitServices.Transactions import TransactionManager


#Get Document
doc = DocumentManager.Instance.CurrentDBDocument
######################################################
#Inputs
piping_system_name=UnwrapElement(IN[0])
######################################################
# Start Code
TransactionManager.Instance.EnsureInTransaction(doc)
piping_systems=FilteredElementCollector(doc).OfCategory(BuiltInCategory.OST_PipingSystem).WhereElementIsElementType().ToElements()


piping_system_by_name=filter(lambda system:system.get_Parameter(BuiltInParameter.SYMBOL_NAME_PARAM).AsValueString()==piping_system_name,piping_systems)

TransactionManager.Instance.TransactionTaskDone()
######################################################
# Output
OUT = piping_system_by_name
# ----------------------------------------
PipingSystem = Output(python_script)
