# Dynamo custom node PipingSegmentsInformation.dyf (Dynamo 2.16.2.5624)
# category: BLIBET_NODES_2025.Pipes.Query

python_script = Python()  # CPython3
# ---------- python_script.python (59 lines) ----------
import System
import clr

#import DSCoreNodes
clr.AddReference('DSCoreNodes')
from DSCore import *

#Import ProtoGeometry
clr.AddReference('ProtoGeometry')
from Autodesk.DesignScript.Geometry import *

# Import RevitNodes
clr.AddReference("RevitNodes")
from Revit import *
import Revit
clr.ImportExtensions(Revit.Elements)
clr.ImportExtensions(Revit.GeometryConversion)

# Import Revit elements
from Revit.Elements import *

# Import RevitAPI
clr.AddReference("RevitAPI")
import Autodesk
from Autodesk.Revit.DB import *

# Import DocumentManager
clr.AddReference("RevitServices")
from RevitServices.Persistence import DocumentManager
from RevitServices.Transactions import TransactionManager


#Get Document
doc = DocumentManager.Instance.CurrentDBDocument

######################################################
# Start Code
TransactionManager.Instance.EnsureInTransaction(doc)
PipingSegments = FilteredElementCollector(doc).OfCategory(BuiltInCategory.OST_PipeSegments).WhereElementIsNotElementType().ToElements()
    
TransactionManager.Instance.TransactionTaskDone()
Size_list_master=[]

for pipeSegment in PipingSegments:
    MEPSizes_list = pipeSegment.GetSizes()
    nominalDiameters=[]
    innerDiameters=[]
    outerDiameters=[]
    pipe_segments_Name=[]
    for MEPSize_Row in MEPSizes_list:
        pipe_segments_Name.append(pipeSegment.Name)
        nominalDiameters.append(MEPSize_Row.NominalDiameter*12*0.0254)
        innerDiameters.append(MEPSize_Row.InnerDiameter*12*0.0254)
        outerDiameters.append(MEPSize_Row.OuterDiameter*12*0.0254)
    x=List.Transpose([pipe_segments_Name,nominalDiameters,innerDiameters,outerDiameters])
    Size_list_master.append(x)
######################################################
# Output
OUT = Size_list_master
# ----------------------------------------
Output = Output(python_script)  # ""
