# Dynamo custom node PointToXYZ.dyf (Dynamo 2.16.2.5624)
# category: BLIBET_NODES_2025.DynamoToRevitAPI.Actions

DynamoPoint = Input(DynamoPoint: var[]..[])
python_script = Python(IN[0]=DynamoPoint)  # CPython3
# ---------- python_script.python (56 lines) ----------
import System
import clr

#import DSCoreNodes
clr.AddReference('DSCoreNodes')
from DSCore import *

#Import ProtoGeometry
clr.AddReference('ProtoGeometry')
from Autodesk.DesignScript.Geometry import *

# Import RevitNodes
clr.AddReference("RevitNodes")
from Revit import *
import Revit
clr.ImportExtensions(Revit.Elements)
clr.ImportExtensions(Revit.GeometryConversion)

# Import Revit elements
from Revit.Elements import *

# Import RevitAPI
clr.AddReference("RevitAPI")
import Autodesk
from Autodesk.Revit.DB import *

# Import DocumentManager
clr.AddReference("RevitServices")
from RevitServices.Persistence import DocumentManager
from RevitServices.Transactions import TransactionManager


#Get Document
doc = DocumentManager.Instance.CurrentDBDocument
######################################################
#Inputs
Input0 = UnwrapElement(IN[0]) 

######################################################
# Start Code
TransactionManager.Instance.EnsureInTransaction(doc)

Input0_list=[]
if isinstance(Input0, list):
    Input0_list = Input0
else:
    Input0_list.append(Input0)

XYZ_list=[]
for point in Input0_list:
    XYZ_list.append(point.ToXyz())
    
TransactionManager.Instance.TransactionTaskDone()
######################################################
# Output
OUT = XYZ_list
# ----------------------------------------
XYZ = Output(python_script)
