# Dynamo custom node RebarEndByName.dyf (Dynamo 2.16.2.5624)
# category: BLIBET_NODES_2025.Structure.Actions

Rebar_End_Treatment_Name = Input(Rebar_End_Treatment_Name: var[]..[])
python_script = Python(IN[0]=Rebar_End_Treatment_Name)  # CPython3
# ---------- python_script.python (49 lines) ----------
import System
import clr

#import DSCoreNodes
clr.AddReference('DSCoreNodes')
from DSCore import *

#Import ProtoGeometry
clr.AddReference('ProtoGeometry')
from Autodesk.DesignScript.Geometry import *

# Import RevitNodes
clr.AddReference("RevitNodes")
from Revit import *
import Revit
clr.ImportExtensions(Revit.Elements)
clr.ImportExtensions(Revit.GeometryConversion)

# Import Revit elements
from Revit.Elements import *

# Import RevitAPI
clr.AddReference("RevitAPI")
import Autodesk
from Autodesk.Revit.DB import *

# Import DocumentManager
clr.AddReference("RevitServices")
from RevitServices.Persistence import DocumentManager
from RevitServices.Transactions import TransactionManager


#Get Document
doc = DocumentManager.Instance.CurrentDBDocument
######################################################
#Inputs

######################################################
# Start Code
TransactionManager.Instance.EnsureInTransaction(doc)
structural_rebars=FilteredElementCollector(doc).OfCategory(BuiltInCategory.OST_Rebar).WhereElementIsElementType().ToElements()

rebar_bar_name=UnwrapElement(IN[0])
rebar_end_by_name=filter(lambda rebar:rebar.get_Parameter(BuiltInParameter.SYMBOL_FAMILY_NAME_PARAM).AsValueString()=="End Treatment" and rebar.get_Parameter(BuiltInParameter.SYMBOL_NAME_PARAM).AsValueString()==rebar_bar_name,structural_rebars)

TransactionManager.Instance.TransactionTaskDone()
######################################################
# Output
OUT = rebar_end_by_name
# ----------------------------------------
Rebar_End_Treatment = Output(python_script)
