# Dynamo custom node StructuralRebars.dyf (Dynamo 2.16.2.5624)
# category: BLIBET_NODES_2025.Structure.Query

python_script = Python()  # CPython3
# ---------- python_script.python (62 lines) ----------
import System
import clr

#import DSCoreNodes
clr.AddReference('DSCoreNodes')
from DSCore import *

#Import ProtoGeometry
clr.AddReference('ProtoGeometry')
from Autodesk.DesignScript.Geometry import *

# Import RevitNodes
clr.AddReference("RevitNodes")
from Revit import *
import Revit
clr.ImportExtensions(Revit.Elements)
clr.ImportExtensions(Revit.GeometryConversion)

# Import Revit elements
from Revit.Elements import *

# Import RevitAPI
clr.AddReference("RevitAPI")
import Autodesk
from Autodesk.Revit.DB import *

# Import DocumentManager
clr.AddReference("RevitServices")
from RevitServices.Persistence import DocumentManager
from RevitServices.Transactions import TransactionManager


#Get Document
doc = DocumentManager.Instance.CurrentDBDocument
######################################################
#Inputs

######################################################
# Start Code
TransactionManager.Instance.EnsureInTransaction(doc)
structural_rebars=FilteredElementCollector(doc).OfCategory(BuiltInCategory.OST_Rebar).WhereElementIsElementType().ToElements()

rebar_bars=[]
rebar_shapes=[]
rebar_hooks=[]
rebar_ends=[]
for rebar in structural_rebars:
    this_type=rebar.get_Parameter(BuiltInParameter.SYMBOL_FAMILY_NAME_PARAM).AsValueString()
    if this_type=="Rebar Bar":
        rebar_bars.append(rebar)
    elif this_type=="Rebar Shape":
        rebar_shapes.append(rebar)
    elif this_type=="Rebar Hook":
        rebar_hooks.append(rebar)
    elif this_type=="End Treatement":
        rebar_ends.append(rebar)


TransactionManager.Instance.TransactionTaskDone()
######################################################
# Output
OUT = rebar_bars,rebar_shapes,rebar_hooks,rebar_hooks
# ----------------------------------------
code_block = CodeBlock(x=python_script) { x[0]; x[1]; x[2]; x[3]; }
Rebar_Bars = Output(code_block.out0)
Rebar_Shapes = Output(code_block.out1)
Rebar_Hooks = Output(code_block.out2)
End_Treatements = Output(code_block.out3)
