# Dynamo custom node TextTypes.dyf (Dynamo 2.16.2.5624)
# category: BLIBET_NODES_2025.Annotate.Text.Actions

python_script = Python()  # CPython3
# ---------- python_script.python (77 lines) ----------
import System
import clr

#import DSCoreNodes
clr.AddReference('DSCoreNodes')
from DSCore import *

#Import ProtoGeometry
clr.AddReference('ProtoGeometry')
from Autodesk.DesignScript.Geometry import *

# Import RevitNodes
clr.AddReference("RevitNodes")
from Revit import *
import Revit
clr.ImportExtensions(Revit.Elements)
clr.ImportExtensions(Revit.GeometryConversion)

# Import Revit elements
from Revit.Elements import *

# Import RevitAPI
clr.AddReference("RevitAPI")
import Autodesk
from Autodesk.Revit.DB import *

# Import DocumentManager
clr.AddReference("RevitServices")
from RevitServices.Persistence import DocumentManager
from RevitServices.Transactions import TransactionManager

doc = DocumentManager.Instance.CurrentDBDocument
#Get Document
text_types_collector = FilteredElementCollector(doc).OfClass(TextNoteType).WhereElementIsElementType().ToElements()
######################################################
elements=[]
colors=[]
line_weights=[]
backgrounds=[]
show_borders=[]
leaders_offset=[]
leader_arroheads=[]
text_fonts=[]
text_sizes=[]
tab_sizes=[]
bolds=[]
italic=[]
underlines=[]
width_factors=[]
newdic=[]
for text_type in text_types_collector:
    elements.append(text_type)
    colors.append(text_type.get_Parameter(BuiltInParameter.SYMBOL_NAME_PARAM).AsInteger())
    line_weights.append(text_type.get_Parameter(BuiltInParameter.LINE_PEN).AsInteger())
    backgrounds.append(text_type.get_Parameter(BuiltInParameter.SYMBOL_NAME_PARAM).AsInteger())
    show_borders.append(text_type.get_Parameter(BuiltInParameter.TEXT_BOX_VISIBILITY).AsInteger())
    leaders_offset.append(text_type.get_Parameter(BuiltInParameter.LEADER_OFFSET_SHEET).AsDouble()*12*25.4)
    leader_arroheads.append(text_type.get_Parameter(BuiltInParameter.LEADER_ARROWHEAD).AsValueString())
    text_fonts.append(text_type.get_Parameter(BuiltInParameter.TEXT_FONT).AsValueString())
    text_sizes.append(text_type.get_Parameter(BuiltInParameter.TEXT_SIZE).AsDouble()*12*25.4)
    tab_sizes.append(text_type.get_Parameter(BuiltInParameter.TEXT_TAB_SIZE).AsDouble()*12*25.4)
    bolds.append(text_type.get_Parameter(BuiltInParameter.TEXT_STYLE_BOLD).AsInteger())
    italic.append(text_type.get_Parameter(BuiltInParameter.TEXT_STYLE_ITALIC).AsInteger())
    underlines.append(text_type.get_Parameter(BuiltInParameter.TEXT_STYLE_UNDERLINE).AsInteger())
    width_factors.append(text_type.get_Parameter(BuiltInParameter.TEXT_WIDTH_SCALE).AsDouble())
text_type_dictionary={"01_Element":elements,"02_Color":colors,"03_Line_Weight":line_weights,"04_Background":backgrounds,"05_Show_Borders":show_borders,"06_Leader_offset":leaders_offset,"07_Leader_Arrowhead":leader_arroheads,"08_Text_Font":text_fonts,"09_Text_Size":text_sizes,"10_Tab_Size":tab_sizes,"11_Bold":bolds,"12_Italic":italic,"13_Underline":underlines,"14_Width_Factor":width_factors}
AsList=elements,colors,line_weights,backgrounds,show_borders,leaders_offset,leader_arroheads,text_fonts,text_sizes,tab_sizes,bolds,italic,underlines,width_factors
transposedList=List.Transpose(AsList)
######################################################
# Start Code
TransactionManager.Instance.EnsureInTransaction(doc)

    
TransactionManager.Instance.TransactionTaskDone()
######################################################
# Output
OUT = text_type_dictionary,transposedList
# ----------------------------------------
code_block = CodeBlock(x=python_script)
# ---------- code_block.designscript (16 lines) ----------
x[0]["01_Element"];
x[0]["02_Color"];
x[0]["03_Line_Weight"];
x[0]["04_Background"];
x[0]["05_Show_Borders"];
x[0]["06_Leader_offset"];
x[0]["07_Leader_Arrowhead"];
x[0]["08_Text_Font"];
x[0]["09_Text_Size"];
x[0]["10_Tab_Size"];
x[0]["11_Bold"];
x[0]["12_Italic"];
x[0]["13_Underline"];
x[0]["14_Width_Factor"];
x[0];
x[1];
# ----------------------------------------
Elements = Output(code_block.out0)
Color = Output(code_block.out1)
LineWeight = Output(code_block.out2)
Background = Output(code_block.out3)
ShowBorders = Output(code_block.out4)
LeaderOffset = Output(code_block.out5)
LeaderArrowhead = Output(code_block.out6)
TextFont = Output(code_block.out7)
TextSize = Output(code_block.out8)
TabSize = Output(code_block.out9)
Bold = Output(code_block.out10)
Italic = Output(code_block.out11)
UnderLine = Output(code_block.out12)
WidthFactor = Output(code_block.out13)
Dictionary = Output(code_block.out14)
ExportableList = Output(code_block.out15)
