# Dynamo custom node WallTypes.dyf (Dynamo 2.16.2.5624)
# category: BLIBET_NODES_2025.SystemFamilies.Arquitecture.Build.Query
# Wall Types, Grouped by SubCategories

python_script = Python()  # CPython3
# ---------- python_script.python (52 lines) ----------
import System
import clr

#import DSCoreNodes
clr.AddReference('DSCoreNodes')
from DSCore import *

#Import ProtoGeometry
clr.AddReference('ProtoGeometry')
from Autodesk.DesignScript.Geometry import *

# Import RevitNodes
clr.AddReference("RevitNodes")
from Revit import *
import Revit
clr.ImportExtensions(Revit.Elements)
clr.ImportExtensions(Revit.GeometryConversion)

# Import Revit elements
from Revit.Elements import *

# Import RevitAPI
clr.AddReference("RevitAPI")
import Autodesk
from Autodesk.Revit.DB import *

# Import DocumentManager
clr.AddReference("RevitServices")
from RevitServices.Persistence import DocumentManager
from RevitServices.Transactions import TransactionManager


#Get Document
doc = DocumentManager.Instance.CurrentDBDocument

walls = FilteredElementCollector(doc).OfCategory(BuiltInCategory.OST_Walls).WhereElementIsElementType().ToElements()
StackedWalls = FilteredElementCollector(doc).OfCategory(BuiltInCategory.OST_StackedWalls).WhereElementIsElementType().ToElements()

BasicWalls = filter(lambda wall: wall.Kind == 0,walls)
CurtainWalls = filter(lambda wall: wall.Kind == 1,walls)

######################################################
# Start Code
TransactionManager.Instance.EnsureInTransaction(doc)
kinds=[]
for wall in walls:
    kinds.append(wall.Kind)
    
TransactionManager.Instance.TransactionTaskDone()
######################################################
# Output
OUT = BasicWalls, CurtainWalls, StackedWalls
# ----------------------------------------
code_block = CodeBlock(x=python_script) { x[0]; x[1]; x[2]; }
BasicWalls = Output(code_block.out0)
CurtainWalls = Output(code_block.out1)
StackedWalls = Output(code_block.out2)
