# Dynamo custom node WindowFamilies.dyf (Dynamo 2.16.2.5624)
# category: BLIBET_NODES_2025.LoadableFamilies.Arquitecture.Build

python_script = Python()  # CPython3
# ---------- python_script.python (49 lines) ----------
import System
import clr

#import DSCoreNodes
clr.AddReference('DSCoreNodes')
from DSCore import *

#Import ProtoGeometry
clr.AddReference('ProtoGeometry')
from Autodesk.DesignScript.Geometry import *

# Import RevitNodes
clr.AddReference("RevitNodes")
from Revit import *
import Revit
clr.ImportExtensions(Revit.Elements)
clr.ImportExtensions(Revit.GeometryConversion)

# Import Revit elements
from Revit.Elements import *

# Import RevitAPI
clr.AddReference("RevitAPI")
import Autodesk
from Autodesk.Revit.DB import *

# Import DocumentManager
clr.AddReference("RevitServices")
from RevitServices.Persistence import DocumentManager
from RevitServices.Transactions import TransactionManager


#Get Document
doc = DocumentManager.Instance.CurrentDBDocument
######################################################
#Inputs
window_families_collector=FilteredElementCollector(doc).OfCategory(BuiltInCategory.OST_Windows).WhereElementIsElementType().ToElements()
######################################################
window_families=[]
family_names=[]
for window in window_families_collector:
    this_window=window.Family
    if this_window.Name not in family_names:
        family_names.append(this_window.Name)
        window_families.append(this_window)

######################################################
# Output
OUT = window_families
# ----------------------------------------
Windows = Output(python_script)
